# Grasshopper definition ToTrace.gh (Grasshopper 1.0.7)
# plug-ins: TOtracing

# Run Matlab & Start Shared Matlab Sesion code.
# After that the program will start.
number_slider = Slider(100, range=0..100)
number_slider_2 = Slider(20, range=0..100)
totr = TOtracing(Xlength=number_slider, Ylength=number_slider_2, Iteration=Slider(0, range=0..10), Volfrac="0.5")  # -> PToutput, TopologyMap
neg = Negative(Value="0.5")
vec = VectorXYZ(XComponent=neg, YComponent=neg, ZComponent=0)  # -> Vector, Length
sqgrid = Square(Plane=PlaneXY(0, 0, 0), Size=1, ExtentX=expr("x-1", number_slider), ExtentY=expr("x-1", number_slider_2))  # -> Cells, Points
move = Move(Geometry=totr.PToutput, Motion=vec.Vector)  # -> Geometry, Transform
vec_2 = VectorXYZ(XComponent=0, YComponent=0, ZComponent=0)  # -> Vector, Length
pt = Point(sqgrid.Points)
preview = CustomPreview(Geometry=move.Geometry, Material=ColourSwatch(SwatchColor=RGB(0, 47, 255)))
move_2 = Move(Geometry=pt, Motion=vec_2.Vector)  # -> flatten(Geometry), Transform
X = XSize(Domain(-0.5, 0.5))
number_slider_3 = Slider(1, range=0..1)
pipe = Pipe(Radius=1, Caps=0)
planesrf = PlaneSurface(Plane=PlaneXY(0, 0, 0), XSize=X, YSize=X)
vec_3 = VectorXYZ(XComponent="0.5", YComponent="0.5", ZComponent=0)  # -> Vector, Length
move_3 = Move(Geometry=planesrf, Motion=vec_3.Vector)  # -> Geometry, Transform
neg_2 = Negative(Value=vec_3.Vector)
move_4 = Move(Geometry=move_3.Geometry, Motion=move_2.Geometry)  # -> flatten(Geometry), Transform
c_script = CSharpScript(x=move_4.Geometry, y=totr.TopologyMap)  # -> A; inputs x: list of Surface, y: list of Int32
# ---------- c_script: C# ----------
    var newList = new List<Surface>();
    for (int i = 0; i < x.Count; i++)
    {
      if(y[i] == 1)
        newList.Add(x[i]);
    }
    A = newList;
# ---------- end c_script ----------
join = BrepJoin(Breps=c_script)  # -> Breps, Closed
preview_2 = CustomPreview(Geometry=join.Breps, Material=ColourSwatch(SwatchColor=RGB(195, 255, 0)))
